# Grasshopper definition Balls.gh (Grasshopper 1.0.7)

python = GhPythonScript(radius=Slider(5, range=0..10), offset=Slider(6, range=0..10), num=Slider(9, range=0..100))  # -> out, a; inputs num: Int32
# ---------- python: Python ----------
__author__ = "anshulpatil"


import rhinoscriptsyntax as rs
import math
mySpheres = []
for i in range(0,num):
    for j in range(0,num):
        myPoint = (i * offset /3 ,j * offset/3,0)
        myRadius = math.sin(i * j) * radius
        s = rs.AddSphere(myPoint, myRadius)
        mySpheres.append(s)

a = mySpheres
# ---------- end python ----------
panel = Panel(python.out)
