# Grasshopper definition GrassHopper.gh (Grasshopper 1.0.7)

srf = Surface(<surface referenced from the Rhino model>)
dim = Dimensions(Surface=srf)  # -> UDimension, VDimension
planesrf = PlaneSurface(Plane=PlaneXY(0, 0, 0), XSize=dim.UDimension, YSize=dim.VDimension)
pop2d = Populate2D(Region=planesrf, Count=100, Seed=1)
voronoi = Voronoi(Points=pop2d, Boundary=planesrf, BruteForceOverride=False)
python = GhPythonScript(crv=voronoi, dir=pop2d, dis=Slider(0.25, range=0..1))  # -> out, a
# ---------- python: Python ----------
__author__ = "anshulpatil"

import rhinoscriptsyntax as rs

a=rs.OffsetCurve(crv,dir,dis)
# ---------- end python ----------
rdiff = RegionDifference(CurvesA=voronoi, CurvesB=flatten(python.a))
boundary = BoundarySurfaces(Edges=rdiff)
Z = UnitZ(Factor=1)
extr = Extrude(Base=boundary, Direction=Z)
bbox = BoundingBox(Content=flatten(extr), Plane=PlaneXY(0, 0, 0), UnionBox=True)  # -> Box, Box_2
srfmorph = SurfaceMorph(
    Geometry=extr,
    Reference=bbox.Box,
    Surface=reparameterize(srf),
    UDomain=Slider(1, range=0..1),
    VDomain=Slider(1, range=0..1),
    WDomain=Slider(1, range=0..1))
