# Grasshopper definition GrasshopperFoldable.gh (Grasshopper 1.0.7)

xz_plane = XZPlane(Origin=Point(0, 0, 0))
triangular = Triangular(Plane=xz_plane, Size=Slider(13, range=0..100), ExtentX=Slider(6, range=0..100), ExtentY=Slider(5, range=0..100))  # -> graft(Cells), Points
md_slider = MDSlider(
    SliderMode=0,
    slider_value=Point(0.3441669134, 0.2284798971, 0.5),
    x_domain=Domain(0, 1),
    y_domain=Domain(0, 1),
    z_domain=Domain(0, 1))
md_slider_2 = MDSlider(
    SliderMode=0,
    slider_value=Point(0.5084451991, 0.4051677425, 0.5),
    x_domain=Domain(0, 1),
    y_domain=Domain(0, 1),
    z_domain=Domain(0, 1))
explode = Explode(Curve=triangular.Cells, Recursive=True)  # -> Segments, Vertices
bounding_box = BoundingBox(Content=flatten(explode.Vertices), Plane=PlaneXY(0, 0, 0), UnionBox=True)  # -> Box, Box_2
evaluate_surface = EvaluateSurface(Surface=reparameterize(bounding_box.Box), Point=[md_slider, md_slider_2])  # -> Point, Normal, UDirection, VDirection, Frame
unit_y = UnitY(Factor=1)
area = Area(Geometry=triangular.Cells)  # -> Area, Centroid
list_item = ListItem(List=explode.Segments, Index=0, Wrap=True)  # -> Item, Item1, Item2
negative = Negative(Value=unit_y)
closest_point = ClosestPoint(Point=area.Centroid, Cloud=evaluate_surface.Point)  # -> ClosestPoint, CPIndex, Distance
bounds = Bounds(Numbers=flatten(closest_point.Distance))
construct_domain = ConstructDomain(DomainStart=Slider(0.1, range=0..1), DomainEnd=Slider(0.7, range=0..1))
line_sdl = LineSDL(Start=area.Centroid, Direction=negative, Length=Slider(1.7, range=0..10))
remap_numbers = RemapNumbers(Value=closest_point.Distance, Source=bounds, Target=construct_domain)  # -> Mapped, Clipped
end_points = EndPoints(Curve=line_sdl)  # -> Start, End
point_on_curve = PointOnCurve([list_item.Item, list_item.Item1, list_item.Item2], parameter=0)
point_on_curve_2 = PointOnCurve([list_item.Item, list_item.Item1, list_item.Item2], parameter=1)
graph_mapper = GraphMapper(remap_numbers.Clipped, x0=0, x1=1, y0=0, y1=1, container_name="Sine", Equation_px=[0, 1], Equation_py=[0, 1])
list_item_2 = ListItem(List=point_on_curve, Index=0, Wrap=True)  # -> Item, Item1, Item2
list_item_3 = ListItem(List=point_on_curve_2, Index=0, Wrap=True)  # -> Item, Item1, Item2
line = Line(StartPoint=list_item_3.Item, EndPoint=end_points.End)
line_2 = Line(StartPoint=list_item_2.Item, EndPoint=list_item_3.Item)
line_3 = Line(StartPoint=list_item_2.Item, EndPoint=end_points.End)
line_4 = Line(StartPoint=list_item_3.Item1, EndPoint=end_points.End)
line_5 = Line(StartPoint=end_points.End, EndPoint=list_item_2.Item1)
line_6 = Line(StartPoint=list_item_3.Item1, EndPoint=list_item_2.Item1)
line_7 = Line(StartPoint=list_item_2.Item2, EndPoint=end_points.End)
line_8 = Line(StartPoint=list_item_3.Item2, EndPoint=end_points.End)
line_9 = Line(StartPoint=list_item_3.Item2, EndPoint=list_item_2.Item2)
join_curves = JoinCurves(Curves=[line_3, line_2, line], Preserve=False)
join_curves_2 = JoinCurves(Curves=[line_8, line_9, line_7], Preserve=False)
join_curves_3 = JoinCurves(Curves=[line_4, line_6, line_5], Preserve=False)
fillet = Fillet(Curve=[join_curves_2, join_curves_3, join_curves], Radius=Slider(0.26, range=0..1))
number_slider = Slider(0, range=0..60)
list_item_4 = ListItem(List=fillet, Index=0, Wrap=True)  # -> Item, Item1, Item2
curve = Curve(list_item.Item1)
curve_2 = Curve(list_item.Item)
curve_3 = Curve(list_item.Item2)
rotate_axis = RotateAxis(Geometry=list_item_4.Item, Angle=remap_numbers.Clipped, Axis=curve_3)  # -> Geometry, Transform
rotate_axis_2 = RotateAxis(Geometry=list_item_4.Item1, Angle=remap_numbers.Clipped, Axis=curve)  # -> Geometry, Transform
rotate_axis_3 = RotateAxis(Geometry=list_item_4.Item2, Angle=remap_numbers.Clipped, Axis=curve_2)  # -> Geometry, Transform
boundary_surfaces = BoundarySurfaces(Edges=rotate_axis.Geometry)
boundary_surfaces_2 = BoundarySurfaces(Edges=rotate_axis_2.Geometry)
boundary_surfaces_3 = BoundarySurfaces(Edges=rotate_axis_3.Geometry)
brep_join = BrepJoin(Breps=[boundary_surfaces, boundary_surfaces_2, boundary_surfaces_3])  # -> Breps, Closed
