# Grasshopper definition Lab 3 Physics simulation in Kangaroo.gh (Grasshopper 1.0.7)
# plug-ins: Bifocals, Kangaroo2 Components

mesh_plane = MeshPlane(Boundary={Plane=PlaneXY(0, 0, 0), Size=Domain2(u=-10..10, v=-10..10)}, WidthCount=10, HeightCount=10)  # -> Mesh, Area
# Physics simulation in Kangaroo
number_slider = Slider(0.62, range=0..1)
meshcorners = MeshCorners(Mesh=mesh_plane.Mesh, Angle=2.35619449)
point = Point([Point(-10, 10, 12.06366717), Point(10, 10, 0), Point(10, -10, 12.23333213), Point(-10, -10, 0)])
edgelengths = EdgeLengths(Mesh=mesh_plane.Mesh, LengthFactor=number_slider, Strength=1)
show = Show(G=mesh_plane.Mesh)
anchor = Anchor(Point=meshcorners, Target=point, Strength=10000)

# ----
# Button for reset.
# 
# Toggle is an on/off control to solve.
boolean_toggle = BooleanToggle(False)

solver = Solver(GoalObjects=[anchor, edgelengths, show], Reset=Button(), Threshold=1e-15, Tolerance=0.01, On=boolean_toggle)  # -> I, V, flatten(O)
panel = Panel(solver.O)
list_item = ListItem(List=solver.O, Index=Slider(0, range=0..100), Wrap=True)
mesh = Mesh(list_item)
