# Grasshopper definition Tensegrity.gh (Grasshopper 1.0.7)
# plug-ins: Kangaroo2 Components

polygon = Polygon(Plane=PlaneXY(0, 0, 0), Radius=Slider(1.62, range=0..10), Segments=Slider(3, range=0..10), FilletRadius=0)  # -> Polygon, Length
Z = UnitZ(Factor=Slider(1.79, range=0..10))
move = Move(Geometry=polygon.Polygon, Motion=Z)  # -> Geometry, Transform
cp = ControlPoints(Curve=polygon.Polygon)  # -> Points, Weights, Knots
cp_2 = ControlPoints(Curve=move.Geometry)  # -> Points, Weights, Knots
removeduplicatepts = RemoveDuplicatePts(Points=cp.Points, Tolerance=0.01)
removeduplicatepts_2 = RemoveDuplicatePts(Points=cp_2.Points, Tolerance=simplify(0.01))
shift = ShiftList(List=removeduplicatepts_2, Shift=1, Wrap=True)
explode = Explode(Curve=polygon.Polygon, Recursive=True)  # -> Segments, Vertices
explode_2 = Explode(Curve=move.Geometry, Recursive=True)  # -> Segments, Vertices
ln = Line(StartPoint=removeduplicatepts, EndPoint=removeduplicatepts_2)
ln_2 = Line(StartPoint=removeduplicatepts, EndPoint=shift)
merge = Merge(Data1=ln, Data2=explode.Segments, Data3=explode_2.Segments)  # -> flatten(Result)
merge_2 = Merge(Data1=flatten(polygon.Polygon), Data2=flatten(move.Geometry), Data3=flatten(ln), Data4=flatten(ln_2))
len = Length(Curve=merge)
multiplication = Multiplication(A=len, B=Slider(0.886, range=0..1))
length_line = LengthLine(Line=ln_2, Length=ln_2, Strength=Slider(1000, range=0..1000))
length_line_2 = LengthLine(Line=merge, Length=multiplication, Strength=10)
show = Show(G=merge_2)
merge_3 = Merge(Data1=flatten(show), Data2=flatten(length_line), Data3=flatten(length_line_2))
solver = Solver(
    GoalObjects=merge_3,
    Reset=Button(),
    Restart=False,
    Parallel=True,
    Threshold=1e-15,
    Tolerance=0.01,
    AddCurrent=False,
    On=Toggle(True))  # -> V, O
lng = ListLength(List=merge_2)  # -> expr("x-1", Length)
subset = SubList(List=solver.O, Domain=lng, Wrap=True)  # -> List, Index
split = SplitList(List=subset.List, Index=Slider(5, range=0..10))  # -> ListA, ListB
pipe = Pipe(Curve=split.ListB, Radius=Slider(0.046, range=0..1), Caps=0)
preview = CustomPreview(Geometry=pipe, Shader=ColourSwatch(SwatchColor=RGB(255, 56, 56)))
preview_2 = CustomPreview(Geometry=split.ListA, Shader=ColourSwatch(SwatchColor=RGB(0, 0, 0)))
