# Grasshopper definition protecc.gh (Grasshopper 1.0.7)
# plug-ins: Weaverbird

curve = Curve(<curve referenced from the Rhino model>)
number_slider = Slider(60, range=0..100)
curve_2 = Curve(<curve referenced from the Rhino model>)
surface = Surface(<surface referenced from the Rhino model>)
curve_3 = Curve(<curve referenced from the Rhino model>)
curve_4 = Curve(<curve referenced from the Rhino model>)
curve_5 = Curve(<curve referenced from the Rhino model>)
curve_6 = Curve(<curve referenced from the Rhino model>)
curve_7 = Curve(<curve referenced from the Rhino model>)
curve_8 = Curve(<curve referenced from the Rhino model>)
curve_9 = Curve(<curve referenced from the Rhino model>)
sweep1 = Sweep1(Rail=curve_4, Sections=curve_3, Miter=1)
sweep1_2 = Sweep1(Rail=curve_2, Sections=curve, Miter=1)
patch = Patch(Curves=surface, Spans=20, Flexibility=1, Trim=True)
unit_z = UnitZ(Factor=Slider(-2, range=-10..10))
scale = Scale(Center=Point(0, 0, 0), Factor=Slider(1.01, range=0..10))  # -> Geometry, Transform
divide_curve = DivideCurve(Curve=curve_6, Count=number_slider, Kinks=False)  # -> Points, Tangents, Parameters
divide_curve_2 = DivideCurve(Curve=curve_7, Count=number_slider, Kinks=False)  # -> Points, Tangents, Parameters
divide_curve_3 = DivideCurve(Curve=curve_5, Count=number_slider, Kinks=False)  # -> Points, Tangents, Parameters
unit_z_2 = UnitZ(Factor=Slider(2, range=-10..10))
offset_curve = OffsetCurve(Curve=curve_9, Distance=Slider(5, range=0..10), Plane=PlaneXY(0, 0, 0), Corners=1)
unit_z_3 = UnitZ(Factor=Slider(15, range=0..15))
unit_z_4 = UnitZ(Factor=Slider(15, range=-15..15))
offset_curve_2 = OffsetCurve(Curve=curve_8, Distance=Slider(-3, range=-15..15), Plane=PlaneXY(0, 0, 0), Corners=1)
populate_geometry = PopulateGeometry(Geometry=patch, Count=Slider(80, range=0..100), Seed=Slider(40, range=0..100))
bounding_box = BoundingBox(Content=patch, Plane=PlaneXY(0, 0, 0))  # -> Box, Box_2
extrude = Extrude(Base=sweep1_2, Direction=unit_z)
extrude_2 = Extrude(Base=sweep1, Direction=unit_z_2)
line = Line(StartPoint=divide_curve_2.Points, EndPoint=divide_curve_3.Points)
line_2 = Line(StartPoint=divide_curve.Points, EndPoint=divide_curve_2.Points)
offset_curve_3 = OffsetCurve(Curve=offset_curve, Distance=Slider(-2, range=-15..15), Plane=PlaneXY(0, 0, 0), Corners=1)
custom_preview = CustomPreview(Geometry=extrude, Material=ColourSwatch(SwatchColor=RGB(104, 115, 130)))
extrude_3 = Extrude(Base=offset_curve_2, Direction=unit_z_3)
point_on_curve = PointOnCurve(line_2, parameter=0.5)
voronoi_3d = Voronoi3D(Points=populate_geometry, Box=bounding_box.Box)  # -> Cells, Boundary
unit_x = UnitX(Factor=Slider(1, range=0..10))
point_on_curve_2 = PointOnCurve(line, parameter=0.5)
extrude_4 = Extrude(Base=offset_curve_3, Direction=unit_z_4)
custom_preview_2 = CustomPreview(Geometry=extrude_2, Material=ColourSwatch(SwatchColor=RGB(104, 115, 130)))
move = Move(Geometry=point_on_curve, Motion=unit_x)  # -> Geometry, Transform
move_2 = Move(Geometry=point_on_curve_2, Motion=unit_x)  # -> Geometry, Transform
brep_brep = BrepBrep(BrepA=patch, BrepB=voronoi_3d.Cells)  # -> Curves, Points
arc_3pt = Arc3Pt(PointA=divide_curve.Points, PointB=move.Geometry, PointC=divide_curve_2.Points)  # -> Arc, Plane, Radius
custom_preview_3 = CustomPreview(Geometry=[extrude_3, extrude_4], Material=ColourSwatch(SwatchColor=RGB(186, 184, 179)))
discontinuity = Discontinuity(Curve=brep_brep.Curves, Level=1)  # -> Points, Parameters
arc_3pt_2 = Arc3Pt(PointA=divide_curve_2.Points, PointB=move_2.Geometry, PointC=divide_curve_3.Points)  # -> Arc, Plane, Radius
loft = Loft(Curves=arc_3pt.Arc, Options={Adjust=False, Closed=False, LoftEnds=0, LoftSimp=0, LoftType=0, Rebuild=10, Refit=0.01})
colour_swatch = ColourSwatch(SwatchColor=RGB(66, 64, 60))
colour_swatch_2 = ColourSwatch(SwatchColor=RGB(66, 64, 60))
average = Average(Input=discontinuity.Points)
loft_2 = Loft(Curves=arc_3pt_2.Arc, Options={Adjust=False, Closed=False, LoftEnds=0, LoftSimp=0, LoftType=0, Rebuild=10, Refit=0.01})
custom_preview_4 = CustomPreview(Geometry=loft, Material=ColourSwatch(SwatchColor=RGB(0, 0, 0)))
polyline = PolyLine(Vertices=discontinuity.Points, Closed=False)
custom_preview_5 = CustomPreview(Geometry=loft_2, Material=ColourSwatch(SwatchColor=RGB(5, 4, 1)))
scale_2 = Scale(Geometry=polyline, Center=average, Factor=Slider(0.75, range=0..1))  # -> Geometry, Transform
loft_3 = Loft(
    Curves=[scale_2.Geometry, polyline],
    Options={Adjust=False, Closed=False, LoftEnds=0, LoftSimp=0, LoftType=0, Rebuild=10, Refit=0.01})
deconstruct_brep = DeconstructBrep(Brep=loft_3)  # -> Faces, Edges, Vertices
mesh_surface = MeshSurface(Surface=deconstruct_brep.Faces, UCount=5, VCount=5, Overhang=True, Equalize=False)  # -> flatten(Mesh)
weaverbird_s_join_meshes_and_weld = WeaverbirdsJoinMeshesAndWeld(Mesh=mesh_surface, Weld=False)
weaverbird_s_catmull_clark_subdivision = WeaverbirdsCatmullClarkSubdivision(MeshCurves=weaverbird_s_join_meshes_and_weld, Level=Slider(2, range=0..10), SmoothNakedEdges=1)
weaverbird_s_mesh_thicken = WeaverbirdsMeshThicken(MeshCurves=weaverbird_s_catmull_clark_subdivision, Distance=Slider(-8, range=-20..10), OffsetType=0)
custom_preview_6 = CustomPreview(Geometry=weaverbird_s_mesh_thicken, Material=ColourSwatch(SwatchColor=RGB(52, 183, 209)))
